# Grasshopper definition GeoOpt_05.gh (Grasshopper 1.0.7)
# plug-ins: Hops

number_slider = Slider(15, range=1..20)
mplane = MeshPlane(
    Boundary={Plane=PlaneXY(0, 0, 0), Size=Domain2(u=-10..10, v=-10..10)},
    WidthCount=number_slider,
    HeightCount=number_slider)  # -> Mesh, Area
panel = Panel("http://127.0.0.1:5000/meshwalker")
python = GhPythonScript(m=mplane.Mesh)  # -> out, a; inputs m: Mesh
# ---------- python: Python ----------
import Rhino.Geometry as rg

exploded = []

for i in range(m.Faces.Count):
    m_copy = m.Duplicate()
    face = m_copy.Faces.ExtractFaces([i])
    exploded.append(face)
    
a = exploded
# ---------- end python ----------
hops = Hops(
    InputMesh=mplane.Mesh,
    FaceIndex1=Slider(1, range=0..10),
    FaceIndex2=Slider(5, range=0..10),
    CacheResultsInMemory=False,
    CacheSolveResults=False,
    RemoteDefinitionLocation="http://127.0.0.1:5000/meshwalker",
    RemoteSolveVersion=(0, 1, 0))  # -> ListOfPoints, ListOfFacesIndexes
panel_2 = Panel(hops.ListOfFacesIndexes)
item = ListItem(List=python.a, Index=hops.ListOfFacesIndexes, Wrap=True)
