# Grasshopper definition GeoOpt_final.gh (Grasshopper 1.0.7)
# plug-ins: Human, Hops

number_slider = Slider(20, range=0..100)

mesh_high_poly = Mesh(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)
mesh_low_poly = Mesh(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)

close_mesh = Mesh(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)
open_tri = Data(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)

mplane = MeshPlane(
    Boundary={Plane=PlaneXY(0, 0, 0), Size=Domain2(u=-10..10, v=-10..10)},
    WidthCount=number_slider,
    HeightCount=number_slider)  # -> Mesh, Area
open_quad = Data(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)
# all shortest paths
mesh = Mesh(mesh_low_poly)
list = ValueList({"edgeLength", "sameWeight"}, selected="edgeLength")
mesh_2 = Mesh(mesh_low_poly)
# MaCAD21
# GeoOpt seminar
# David A. Leon and Dai Kandil
# shortest walk
mesh_3 = Mesh(mesh_low_poly)
# minimum spanning trees
panel = Panel("http://127.0.0.1:5000/meshstripper")
# K-Means clustering
mesh_4 = Mesh(mesh_low_poly)
panel_2 = Panel("http://127.0.0.1:5000/mst")

# ---- group: MESHSTRIPPER
hops = Hops(
    Mesh=mesh,
    WeightMode=list,
    CacheResultsInMemory=True,
    CacheSolveResults=True,
    RemoteDefinitionLocation="http://127.0.0.1:5000/meshstripper",
    RemoteSolveVersion=(0, 1, 0))  # -> ShortestPath, FacesIndex, Lengths

# ----
explodemesh = GhPythonScript(m=mesh_2)  # -> out, a; inputs m: Mesh
# ---------- explodemesh: Python ----------
import Rhino.Geometry as rg

ghenv.Component.Message = "explode mesh"

exploded = []

for i in range(m.Faces.Count):
    m_copy = m.Duplicate()
    face = m_copy.Faces.ExtractFaces([i])
    exploded.append(face)
    
a = exploded
# ---------- end explodemesh ----------

# ---- group: MST
hops_2 = Hops(
    InputMesh=mesh_2,
    Weigth="1",
    CacheResultsInMemory=True,
    CacheSolveResults=True,
    RemoteDefinitionLocation="http://127.0.0.1:5000/mst",
    RemoteSolveVersion=(0, 1, 0))  # -> ListOfFacesIndexes, Lines

# ----
explodemesh_2 = GhPythonScript(m=mesh_4)  # -> out, a; inputs m: Mesh; same code as explodemesh
explodemesh_3 = GhPythonScript(m=mesh)  # -> out, a; inputs m: Mesh; same code as explodemesh
panel_3 = Panel("http://127.0.0.1:5000/meshwalker")
python = GhPythonScript(x=hops_2.ListOfFacesIndexes)  # -> out, a
# ---------- python: Python ----------
import json
import ghpythonlib.treehelpers as th

l = th.list_to_tree(json.loads(x))

a = l
# ---------- end python ----------
partition = PartitionList(List=hops.ShortestPath, Size=hops.Lengths)
partition_2 = PartitionList(List=hops.FacesIndex, Size=hops.Lengths)
explodemesh_4 = GhPythonScript(m=mesh_3)  # -> out, a; inputs m: Mesh; same code as explodemesh

# ---- group: MESHWALKER
hops_3 = Hops(
    Reset=Button(),
    InputMesh=mesh_3,
    FaceIndex1=Slider(15, range=0..100),
    FaceIndex2=Slider(94, range=0..100),
    CacheResultsInMemory=True,
    CacheSolveResults=True,
    RemoteDefinitionLocation="http://127.0.0.1:5000/meshwalker",
    RemoteSolveVersion=(0, 1, 0))  # -> ListOfPoints, ListOfFacesIndexes

# ----
item = ListItem(List=explodemesh.a, Index=python.a, Wrap=True)
item_2 = ListItem(List=explodemesh_3.a, Index=partition_2, Wrap=True)

# ---- group: define features to cluster
area = Area(Geometry=explodemesh_2.a)  # -> Area, Centroid
medges = MeshEdges(Mesh=explodemesh_2.a)  # -> NakedEdges, InteriorEdges, NonManifoldEdges
join = JoinCurves(Curves=[medges.NakedEdges, medges.InteriorEdges], Preserve=False)
len = Length(Curve=join)  # -> flatten(Length)

# ----
pline = PolyLine(Vertices=partition, Closed=False)
item_3 = ListItem(List=explodemesh_4.a, Index=hops_3.ListOfFacesIndexes, Wrap=True)
mjoin = MeshJoin(Meshes=item_2)

strips = Data(item)
paths = Data(hops_2.Lines)

strips_2 = Data(mjoin)
path = Data(pline)

tstat = TreeStatistics(Tree=item)  # -> Paths, Length, Count
series = Series(Start=0, Step=1, Count=tstat.Count)
preview = CustomPreview(
    Geometry=item_3,
    Material={diffuse=RGB(221, 160, 221), emission=RGB(66, 48, 66), shine=0.5, specular=RGB(255, 255, 255), transparency=0})
tstat_2 = TreeStatistics(Tree=partition_2)  # -> Paths, Length, Count
gradient = Gradient(
    LowerLimit=0,
    UpperLimit=tstat.Count,
    Parameter=series,
    stops=[0: RGB(255, 221, 0), 0.852: RGB(56, 56, 56), 1: RGB(51, 51, 51)])
entwine = Entwine(Branch00=len, Branch01=area.Area, FlattenInputs=True)
series_2 = Series(Start=0, Step=1, Count=tstat_2.Count)
clean = CleanTree(RemoveNulls=True, RemoveInvalid=True, RemoveEmpty=True, Tree=entwine)
gradient_2 = Gradient(
    LowerLimit=0,
    UpperLimit=tstat_2.Count,
    Parameter=series_2,
    stops=[0: RGB(0, 98, 0), 0.25: RGB(81, 175, 17), 0.5: RGB(159, 198, 146), 0.75: RGB(170, 235, 41), 1: RGB(221, 255, 53)])
python_2 = GhPythonScript(x=clean)  # -> out, a; inputs x: tree
# ---------- python_2: Python ----------
import Rhino.Geometry as rg
import ghpythonlib.treehelpers as th

def transpose(l):
    return map(list, zip(*l))
    


vec = th.tree_to_list(x)
features = len(vec)
dimensions = len(vec[0])

tvec = transpose(vec)

str_vecs = []
for v in tvec:
    empty = "[" 
    for i in range(len(v)):
        empty += str(v[i])
        if i != len(v)-1: empty += ","
        
    empty += "]"
    str_vecs.append(empty)
a = str_vecs
# ---------- end python_2 ----------
panel_4 = Panel(python_2.a)
jitter = Jitter(List=gradient, Jitter=1, Seed=2)  # -> Values, Indices
jitter_2 = Jitter(List=gradient_2, Jitter=1, Seed=Slider(4, range=0..10))  # -> Values, Indices
number_slider_2 = Slider(7, range=0..10)
preview_2 = CustomPreview(Geometry=strips_2, Material=graft(jitter_2.Values))
previewlw = CustomPreviewLineweights(Geometry=path, Shader=ColourSwatch(SwatchColor=RGB(0, 255, 187)), Thickness=3, Absolute=False)
panel_5 = Panel("http://127.0.0.1:5000/kmeans")
preview_3 = CustomPreview(Geometry=strips, Material=graft(jitter.Values))
previewlw_2 = CustomPreviewLineweights(Geometry=paths, Shader=ColourSwatch(SwatchColor=RGB(0, 255, 187)), Thickness=3, Absolute=False)
hops_4 = Hops(
    Vectors=python_2.a,
    NumberOfClusters=number_slider_2,
    CacheResultsInMemory=True,
    CacheSolveResults=True,
    RemoteDefinitionLocation="http://127.0.0.1:5000/kmeans",
    RemoteSolveVersion=(0, 1, 0))
panel_6 = Panel(hops_4)
python_3 = GhPythonScript(items=explodemesh_2.a, C=hops_4, k=number_slider_2)  # -> out, a; inputs items: list, C: list of Int32, k: Int32
# ---------- python_3: Python ----------
import Rhino.Geometry as rg
import ghpythonlib.treehelpers as th

clusters = [[] for i in range(k)]

for i in range(len(items)):
    clusters[C[i]].append(items[i])

a = th.list_to_tree(clusters)
# ---------- end python_3 ----------
tstat_3 = TreeStatistics(Tree=python_3.a)  # -> Paths, Length, Count
series_3 = Series(Start=0, Step=1, Count=tstat_3.Count)
gradient_3 = Gradient(
    LowerLimit=0,
    UpperLimit=tstat_3.Count,
    Parameter=series_3,
    stops=[0: RGB(243, 57, 0), 0.1: RGB(236, 27, 60), 0.2: RGB(210, 0, 118), 0.3: RGB(103, 0, 120), 0.4: RGB(39, 72, 161), 0.5: RGB(1, 192, 229), 0.6: RGB(18, 178, 90), 0.7: RGB(79, 186, 8), 0.8: RGB(220, 237, 32), 0.9: RGB(247, 159, 20), 1: RGB(243, 57, 0)])
preview_4 = CustomPreview(Geometry=python_3.a, Material=graft(gradient_3))
