# Grasshopper definition Mastalski_Assignment_1.2-UV-quad-remeshgh.gh (Grasshopper 1.0.7)

file_path = FilePath("A:\Architektura prace\IAAC 3.S.3 aia-geo-opt\aia-geo-opt-git\aia-geo-opt_Mastalski\py_files\Mastalski_Assignment_1.2-quad-remesh.py")

# ---- group: default mesh creation
number_slider = Slider(1, range=0..1)
number_slider_2 = Slider(0.298, range=0..1)

# ---- group: u v mesh creation
number_slider_3 = Slider(12, range=1..20)
number_slider_4 = Slider(12, range=1..20)

# ----
# Old version with boundary mesh UV creation with triangulation
number_slider_5 = Slider(10, range=2..10)
ghpython_script = GhPythonScript(
    x=number_slider_5,
    y=Slider(10, range=1..10),
    div=Slider(10, range=4..15),
    deg=Slider(10, range=1..10),
    m_den=number_slider,
    m_min_e=number_slider_2,
    m_U=number_slider_3,
    m_V=number_slider_4)  # -> out, line, div_pt, v1, div_pt_moved, nested_pt, nurbs_crv, loft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; inputs deg: Int32, m_U: Int32, m_V: Int32; disabled
# ---------- ghpython_script: Python ----------
import Rhino.Geometry as rg
import ghpythonlib.treehelpers as th
import math

pt_list1 = []
pt_list2 = []
x = int(x)
y = int(y)
div = int(div)


for i in range(x):    
    p1 = rg.Point3d(i, 0, 0)
    pt_list1.append(p1)

for i in range(x):    
    p2 = rg.Point3d(i, y, 0)
    pt_list2.append(p2)

#create lines
line = []

for i in range(len(pt_list1)):
    l = rg.LineCurve(pt_list1[i], pt_list2[i])
    line.append(l)

#get div parameters
div_par = []

for i in line:
    div_par.append(i.DivideByCount(div, True))

#print(div_par)
#print(len(div_par))

#create div points
div_pt = []

#flat list method

for i in range(len(line)):
    for j in range(len(div_par[i])):
        div_pt.append(line[i].PointAt(div_par[i][j]))

#nested list method

#for i in range(len(line)):
#    t = []
#    for j in range(len(div_par[i])):
#        t.append(line[i].PointAt(div_par[i][j]))
#    div_pt.append(t)

#print(len(div_pt))

#translate points into vectors

v1 = []

for i in div_pt:
    v1.append(rg.Vector3d(i))

#get vector length

v1_len = []

for i in v1:
    v1_len.append(i.Length)

v1_len_sin = []

for i in v1_len:
    v1_len_sin.append(math.sin(i))

#print(v1_len_sin)

#create vector z

v_z = []

for i in v1_len_sin:
    v_z.append(rg.Vector3d(0,0,i))

#move points using vectors

div_pt_moved = []

for i in range(len(div_pt)):
    div_pt_moved.append(div_pt[i] - v_z[i])

#print(div_pt_moved)

#create nurbs curve

#nested_pt = []
#
#for i in range(len(line)):
#    t = []
#    t.append(div_pt_moved[:len(div_par[i])])
#    nested_pt.append(t)
#test tree transition
#a = th.list_to_tree(nested_pt)

deg = int(deg)
nurbs_crv = []
t = div_pt_moved[:]

for i in range(len(line)):
    t = div_pt_moved[i*(len(div_par[i])):len(div_par[i])*(i+1)]
    c = rg.NurbsCurve.Create(False, deg, t)
    nurbs_crv.append(c)

#print(nurbs_crv)

#create loft

norm_loft = rg.LoftType.Normal
no_pt = rg.Point3d.Unset
loft = rg.Brep.CreateFromLoft(nurbs_crv,no_pt,no_pt,norm_loft,False)

#create mesh

m_param = rg.MeshingParameters(m_den, m_min_e)
mesh = rg.Mesh.CreateFromBrep(loft[0], m_param)

#evaluate srf and get U V mesh output
pta = rg.Point3d(0, 0, 0)
ptb = rg.Point3d(0, 1, 0)


srf = loft[0].Faces[0]

pts = {}
srfs = []
grid = []
nrows = m_U
ncolumns = m_V

u_domain = rg.Interval(0, m_U)
v_domain = rg.Interval(0, m_V)
srf.SetDomain(0, u_domain)
srf.SetDomain(1, v_domain)

for i in range(0, m_U + 1):
    gcolumn = []
    for j in range(0, m_V + 1):
        pts[(i, j)] = rg.Surface.PointAt(srf, i, j)
        gcolumn.append(rg.Surface.PointAt(srf, i, j))
    grid.append(gcolumn)


for i in range(0, m_U):
    pcolumn = []
    for j in range(0, m_V):
        panel = rg.NurbsSurface.CreateFromCorners(pts[i,j], pts[i+1,j], pts[i+1,j+1], pts[i,j+1])
        pcolumn.append(panel)
    srfs.append(pcolumn)

srfs = th.list_to_tree(srfs)
grid = th.list_to_tree(grid)


m_plines = []

for i in range(0, m_U):
    pcolumn = []
    for j in range(0, m_V):
        panel = rg.Polyline([pts[i,j], pts[i+1,j], pts[i+1,j+1], pts[i,j+1], pts[i,j]])
        pcolumn.append(panel)
    m_plines.append(pcolumn)

#quads from planarized points

planar_pts = {}
planes = []


#try IEnumerable methods
#from System.Collections.Generic import IEnumerable

#print([pts[0,0], pts[0+1,0], pts[0+1,0+1], pts[0,0+1]])

#for i in range(0, m_U):
#    pcolumn = []
#    for j in range(0, m_V):
##        p_cloud = IEnumerable[rg.Point3d]([pts[i,j], pts[i+1,j], pts[i+1,j+1], pts[i,j+1]])
#        pts_ie = [pts[i,j], pts[i+1,j], pts[i+1,j+1], pts[i,j+1]]
#        planes.append(plane.FitPlaneToPoints(pts_ie))



#for i in range(0, m_U):
#    pcolumn = []    
#    for j in range(0, m_V):
#        plane = rg.Plane.Unset
#        pts_ie = [pts[i,j], pts[i+1,j], pts[i+1,j+1], pts[i,j+1]]
#        p_fit = plane.FitPlaneToPoints(pts_ie)
#        for k in range(len(pts_ie)):
#            planar_pts[(i,j)] = p_fit[1].ClosestPoint(pts_ie[k])

for i in range(0, m_U):
    pcolumn = []    
    plane = rg.Plane.Unset
    for j in range(0, m_V):
        if i == 0 and j == 0:            
            pts_ie = [pts[i,j], pts[i+1,j], pts[i+1,j+1], pts[i,j+1]]
            p_fit = plane.FitPlaneToPoints(pts_ie)
            planar_pts[(i,j)] = p_fit[1].ClosestPoint(pts[i,j])
            planar_pts[(i+1,j)] = p_fit[1].ClosestPoint(pts[i+1,j])
            planar_pts[(i+1,j+1)] = p_fit[1].ClosestPoint(pts[i+1,j+1])
            planar_pts[(i,j+1)] = p_fit[1].ClosestPoint(pts[i,j+1])
        elif i == 0:            
            pts_ie = [planar_pts[i,j], planar_pts[i+1,j], pts[i+1,j+1], pts[i,j+1]]
            p_fit = plane.FitPlaneToPoints(pts_ie)
            planar_pts[(i+1,j+1)] = p_fit[1].ClosestPoint(pts[i+1,j+1])
            planar_pts[(i,j+1)] = p_fit[1].ClosestPoint(pts[i,j+1])
        else:
            pts_ie = [planar_pts[i,j], pts[i+1,j], pts[i+1,j+1], planar_pts[i,j+1]]
            p_fit = plane.FitPlaneToPoints(pts_ie)
            planar_pts[(i+1,j)] = p_fit[1].ClosestPoint(pts[i+1,j])
            planar_pts[(i+1,j+1)] = p_fit[1].ClosestPoint(pts[i+1,j+1])

#print(planar_pts)

#print(planes)
#mesh creation

m_p_mesh = []

for i in m_plines:
    for j in i:
        m_p_mesh.append([rg.Mesh.CreateFromClosedPolyline(j)])

m_joined = rg.Mesh()

for i in m_p_mesh:
    m_joined.Append(i)

#print(m_joined)
#m_joined_w = m_joined.Weld(math.pi/2)
m_joined_w = m_joined.UnifyNormals()

#print(m_joined_w)

m_p_mesh = th.list_to_tree(m_p_mesh)
m_plines = th.list_to_tree(m_plines)
# ---------- end ghpython_script ----------
data = Data(ghpython_script.loft)
uv_mesh_joined = Data(ghpython_script.m_joined)
uv_mesh_weld = Data(ghpython_script.m_joined_w)
point = Point(ghpython_script.planar_pts)
data_2 = Data(ghpython_script.line)
data_3 = Data(ghpython_script.div_pt)
data_4 = Data(ghpython_script.v1)
data_5 = Data(ghpython_script.div_pt_moved)
nurbs_curves = Data(ghpython_script.nurbs_crv)
default_mesh_creation = Data(ghpython_script.mesh)
surface = Data(ghpython_script.srf)

# ---- group: default mesh creation
number_slider_6 = Slider(1, range=0..1)
number_slider_7 = Slider(0.298, range=0..1)

# ---- group: u v mesh creation
number_slider_8 = Slider(9, range=1..20)
number_slider_9 = Slider(9, range=1..20)

# ----
# 1. list
series = Series(Start=0, Step=1, Count=Slider(10, range=0..10))
read_file = ReadFile(File=file_path, PerLineParse=False)
# pseudo-code with hints
python = GhPythonScript()  # -> out, a, b, c, d, e, f, g
# ---------- python: Python ----------
#you will need all this libraries
import Rhino.Geometry as rg
import ghpythonlib.treehelpers as th #this one is to import nested lists to grasshopper trees
import math


#----------------------------------------------------------
#1.- create first series of points -
#start by initializing an empty list and fill it with points 
#by creating points with a for loop. The number of points should come 
#from a grasshopper slider
#Increment the X coordinate of the point at each iteration so to create
#a series of points along the X axis line
#store that point to the list
#output this list to grasshopper to verify the result should look like gh component (1.)

pointList1 = []

#your code here


a = pointList1

#----------------------------------------------------------
#2. - create second series of points -
#create a second list of points  by copying the code above, but this time
#assign the Y coordinate of each point to a value that comes from an 
#external input which can be a slider in grasshopper
#output that list as well, the result should look like component (2.) 

pointList2 = []

#your code here

b = pointList2


#----------------------------------------------------------
#3. - create lines from two serie of points - 
#initialize another empty list to store some lines
#make another for loop that iterates through each point in any of the list BY INDEX
#within this loop, make a line that draws from points in both lists with the same index
#and append that line to the line list. output the result
#hint: you only need one for loop for this

lineList = []

#your code here


c = lineList

#----------------------------------------------------------
#4.- divide curve -
#initialize another empty list to store some curves
#interate through every line in the line list with a for loop 
#inside the scope of this for loop, create an empty list to store the division points
#inside the for loop, convert each line to a nurbs curve, like shown in class
#divide the new curve into 10 points by applying DivideByCount() method (see rhinocommo) and store the result
#this returns a list of parameters in the line which correspond to each parameter
#you need to iterate through the list of params with another for loop and get the point per each param 
#using Line.PointAt(), and there the points in the list of divison points

allDivPts = [] #this will be a list of lists
for line in lineList:
    linePts =[] #create an empty list to fill each iteration
    #some code goes here....
    
    
    
    for p in params:
        #some code goes here....
        
        linePts.append(divPt)

    #here you return to the scope of the first for loop
    allDivPts.append(linePts) #append the list of points PER LINE to another list

d = th.list_to_tree(allDivPts) #this is how you output nested lists to gh trees

#----------------------------------------------------------
#5.- apply sine function to points
#here we will use the sin() the math library to move the points in Z, 
#it makes sense to follow the logic of group 5. of gh components
#first, create a nested for loop to iterate the nested list by index (I´ve done that for you)
#second, transfor the pt to a vector3d
#third, get the vector length (it´s one of it´s properties)
#forth, create a variable that will be the magnitude of displacement, by passign the vector length to the math.sin() function
#fifth, create another 3d vector, which is is the Z vector times the previous variable
#sixth, get a new point by substracting the point to the vector (literally, a point - a vector results in another point)
#finally, append that point to a list, and then append that list to the nested list


allMovedPts = [] #list of all moved points
for list in allDivPts:
    movedPts= [] #list of moved points
    #some code goes here....
    
    
    for pt in list:
        #some code goes here....


        movedPts.append(newPt)
    movedPts.append(sinePts)

d = th.list_to_tree(movedPts) #output list of list to gh

#----------------------------------------------------------
#6.- make a curve from a list of points
#again, initialize a en empty list which will contain curves
#interate through the list of list of points with a for loop
#create a curve with rg.Curve.CreateInterpolatedCurve() as in 6. (see rhinocommon)
#append that curve to the list of curves and output it to gh

#make a curve from list of points
curveList = []

#your code goes here

e= curveList

#----------------------------------------------------------
# 7.- create a loft surface from curves
#use rg.Brep.CreateFromLoft() (see rc) to create a surface from loft
#store it in a variable and output it to gh



f = surface
#----------------------------------------------------------
#8.- create a mesh from Breo
#The last step is to create a mesh from a Brep using rg.Mesh.CreateFromBrep(), store it and output it to gh
#keep in mind that CreateFromBrep needs one Brep and CreateFromLoft() returns a list (even if only of one element)

g = mesh

#THE END
# ---------- end python ----------
file_path_2 = FilePath("A:\Architektura prace\IAAC 3.S.3 aia-geo-opt\aia-geo-opt-git\aia-geo-opt_Mastalski\files\test.py")
ghpython_script_2 = GhPythonScript(
    Code=read_file,
    X=Slider(10, range=2..10),
    Y=Slider(10, range=1..10),
    Div=Slider(10, range=4..15),
    Deg=Slider(10, range=1..10),
    M_den=number_slider_6,
    M_min_e=number_slider_7,
    M_U=number_slider_8,
    M_V=number_slider_9)  # -> Out, Line, Div_pt, V1, Div_pt_moved, Nested_pt, Nurbs_crv, Loft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

# ---- group: 1.
# 2. points
pt = ConstructPoint(XCoordinate=series, YCoordinate=0, ZCoordinate=0)

# ----
construct_point = ConstructPoint(XCoordinate=series, YCoordinate=Slider(10, range=0..10), ZCoordinate=0)
read_file_2 = ReadFile(File=file_path_2, PerLineParse=False)

data_6 = Data(ghpython_script.grid)
surface_divided_uv = Data(ghpython_script.srfs)

points_in_branches = Data(ghpython_script.m_plines)
uv_mesh_creation = Data(ghpython_script.m_p_mesh)

data_7 = Data(ghpython_script_2.Line)
data_8 = Data(ghpython_script_2.Div_pt)
data_9 = Data(ghpython_script_2.V1)
data_10 = Data(ghpython_script_2.Div_pt_moved)
nurbs_curves_2 = Data(ghpython_script_2.Nurbs_crv)
data_11 = Data(ghpython_script_2.Loft)
default_mesh_creation_2 = Data(ghpython_script_2.Mesh)
surface_2 = Data(ghpython_script_2.Srf)

data_12 = Data(ghpython_script_2.Grid)
surface_divided_uv_2 = Data(ghpython_script_2.Srfs)

points_in_branches_2 = Data(ghpython_script_2.M_plines)
uv_mesh_creation_2 = Data(ghpython_script_2.M_p_mesh)

uv_mesh_joined_2 = Data(ghpython_script_2.M_joined)  # disabled
uv_mesh_weld_2 = Data(ghpython_script_2.M_joined_w)  # disabled

# ----
# UV mesh quad working
uv_mesh_joined_3 = Data(ghpython_script_2.M_p_mesh_test)

panel = Panel(ghpython_script_2.Out)

# ---- group: 3.
# 3. line
ln = Line(StartPoint=pt, EndPoint=construct_point)

# ----
ghpython_script_3 = GhPythonScript(Code=read_file_2)  # -> Out, A
panel_2 = Panel(ghpython_script_3.Out)
brep_edges = BrepEdges(Brep=surface_divided_uv_2)  # -> Naked, Interior, NonManifold

# ---- group: 4.
# 4. divide curve
divide = DivideCurve(Curve=ln, Count=10, Kinks=False)  # -> Points, Tangents, Parameters

# ----
point_2 = Point([Point(-15, 4.469246488, 4.145696009), Point(-15, 28, 8.282020228), Point(9, 28, 0), Point(9, 0, -4.775743433)])
construct_plane = ConstructPlane(Origin=Point(0, 0, 0), XAxis="{5,4,0}", YAxis="{-4,6,0}")

# ---- group: 5.
vec = Vector(divide.Points)
vlen = VectorLength(Vector=vec)
sin = Sine(Value=vlen)
Z = UnitZ(Factor=sin)
# 5. vector
move = Move(Geometry=divide.Points, Motion=Z)  # -> Geometry, Transform

# ----
ghpython_script_4 = GhPythonScript(x=point_2)  # -> out, a, pl; inputs x: list of Point3d
# ---------- ghpython_script_4: Python ----------
import Rhino.Geometry as rg

a = []
plane = rg.Plane.Unset

pl = plane.FitPlaneToPoints(x)

#for i in range(len(x)):
#    a.append(plane.ClosestPoint(x[i]))
# ---------- end ghpython_script_4 ----------
data_13 = Data(ghpython_script_4.a)
data_14 = Data(ghpython_script_4.pl)
panel_3 = Panel(ghpython_script_4.pl)

# ---- group: 6.
# 6. curve
intcrv = Interpolate(Vertices=move.Geometry, Degree=3, Periodic=False, KnotStyle=1)  # -> Curve, Length, Domain

# ---- group: 7.
# 7. surface
loft = Loft(
    Curves=flatten(intcrv.Curve),
    Options={Adjust=False, Closed=False, LoftEnds=0, LoftSimp=0, LoftType=0, Rebuild=10, Refit=0.01})

# ---- group: 8.
# 8. mesh
mesh_uv = MeshSurface(Surface=loft, UCount=Slider(10, range=0..10), VCount=Slider(7, range=0..10), Overhang=True, Equalize=False)
