# Grasshopper definition Mastalski_Assignment_2.gh (Grasshopper 1.0.7)
# plug-ins: MeshEdit Components

python = GhPythonScript(x=Slider(10, range=1..20), y=Slider(10, range=1..20), U=Slider(20, range=1..20), V=Slider(20, range=1..20))  # -> out, a, c, d, e, f, g, h; inputs x: Int32, U: Int32, V: Int32
# ---------- python: Python ----------
import Rhino.Geometry as rg
import ghpythonlib.treehelpers as th
import math
import ghpythonlib.components as ghc

#this is how you initialize a list in python
pointList1 = []
pointList2 = []
for i in range(x):
    pt1 = rg.Point3d(i, 0, 0)
    pt2 = rg.Point3d(i, y, 0)
    pointList1.append(pt1)
    pointList2.append(pt2)

a = pointList1

lineList = []
for i in range(len(pointList1)):
    line = rg.Line(pointList1[i], pointList2[i])
    lineList.append(line)
c = lineList


allDivPts = []
for l in lineList:
    divPts = [] #my list of division points
    nc = l.ToNurbsCurve()
    params = nc.DivideByCount(V, True)
    for p in params:
        divPt = nc.PointAt(p)
        
        vec= rg.Vector3d(divPt)
        vecLen = vec.Length
        mag = math.sin(vecLen)
        transVec = -rg.Vector3d.ZAxis * mag
        
        newPt = divPt - transVec
        divPts.append(newPt)

    allDivPts.append(divPts)

d = th.list_to_tree(allDivPts)


#make a curve from list of points
curveList = []
for i in range(len(allDivPts)):
    curve = rg.Curve.CreateInterpolatedCurve(allDivPts[i], 3)
    curveList.append(curve)
e= curveList


#create a loft surface from curves
surface = rg.Brep.CreateFromLoft(curveList, rg.Point3d.Unset, rg.Point3d.Unset, rg.LoftType.Normal, False)
surface = surface[0].Faces[0]

f = surface

#reparametrize surface
surface.SetDomain(0,rg.Interval(0,U))
surface.SetDomain(1,rg.Interval(0,V))

#get points
allSrfPts=[]
for i in range(U+1):
    srfPts= []
    for j in range(V+1):
        pt=rg.Surface.PointAt(surface,i,j)
        srfPts.append(pt)
    allSrfPts.append(srfPts)
h = allSrfPts


mesh = rg.Mesh()
for i in range(len(allSrfPts)-1):
    for j in range(len(allSrfPts[i])-1):
        m = rg.Mesh()
        v1 = allSrfPts[i][j]
        v2 = allSrfPts[i][j+1]        
        v3 = allSrfPts[i+1][j+1]        
        v4 = allSrfPts[i+1][j]
        
        m.Vertices.Add(v1)
        m.Vertices.Add(v2)
        m.Vertices.Add(v3)
        m.Vertices.Add(v4)
        
        m.Faces.AddFace(0,1,2,3)
        
        mesh.Append(m)

g = mesh

cleanmesh = mesh
#methods to clean a mesh
cleanmesh.Normals.ComputeNormals()
cleanmesh.Vertices.CombineIdentical(True, True)
cleanmesh.Vertices.CullUnused()
cleanmesh.Weld(3.14159265358979)
cleanmesh.UnifyNormals()
cleanmesh.FaceNormals.ComputeFaceNormals()
cleanmesh.Compact()


h = cleanmesh
# ---------- end python ----------
# Assignment 2
mesh_sphere_ex = MeshSphereEx(Base=PlaneXY(0, 0, 0), Radius=10, Count=5)
mesh_flip = MeshFlip(Mesh=python.h)
file_path = FilePath("A:\Architektura prace\IAAC 3.S.3 aia-geo-opt\aia-geo-opt-git\aia-geo-opt_Mastalski\py_files\Mastalski_Assignment_2.py")

# ---- group: create sun Vector
python_2 = GhPythonScript(x=Slider(0.57, range=0..1), y=Slider(0.35, range=0..1))  # -> out, a, b, c
# ---------- python_2: Python ----------
import Rhino.Geometry as rg
import math

#create a sun vector

#1. create a Sphere at point (0,0,0) with radius 1 and output it to a
#output the sphere to a

orig = rg.Point3d(0, 0, 0)
a = rg.Sphere(orig, 1)

#2. evaluate a point in the sphere using rg.Sphere.PointAt() at coordintes x and y
#the point should only be on the upper half of the sphere (upper hemisphere)
#the angles are in radians, so you might want to use math.pi for this
#output the point to b

x_r = x * 2 * math.pi
y_r = y * math.pi

#print(y_r)

b = a.PointAt(x_r, y_r)

#create a vector from the origin  and reverse the vector
#keep in mind that Reverse affects the original vector
#output the vector to c

#print(orig)
c = rg.Vector3d.Negate(rg.Vector3d(b-orig)) #wouldn't it be easier just to calculate the right vector in first place???
# ---------- end python_2 ----------

# ---- group: replaceable mesh
mesh = Data(mesh_flip)

# ---- group: your .py file goes here
path = FilePath(file_path)

# ----
vdis = VectorDisplay(Anchor=python_2.b, Vector=python_2.c)
file = ReadFile(File=path, PerLineParse=False)
python_3 = GhPythonScript(Code=file, M=mesh, S=python_2.c)  # -> Out, A, B, C, D, E, F
panel = Panel(python_3.Out)
panel_2 = Panel(python_3.A)
bnd = Bounds(Numbers=python_3.C)
data = Data(python_3.D)
dedomain = DeconstructDomain(Domain=bnd)  # -> Start, End
vdis_2 = VectorDisplay(Anchor=python_3.B, Vector=python_3.A)
gradient = Gradient(
    LowerLimit=dedomain.Start,
    UpperLimit=dedomain.End,
    Parameter=python_3.C,
    stops=[0: RGB(234, 38, 0), 0.25: RGB(234, 126, 0), 0.5: RGB(254, 244, 84), 0.75: RGB(173, 203, 249), 1: RGB(75, 107, 169)])
preview = CustomPreview(Geometry=python_3.F, Material=gradient)
