# Grasshopper definition Mastalski_Assignment_3.gh (Grasshopper 1.0.7)
# plug-ins: Hops, Kangaroo2 Components

point = Point(Point(26.82950961, 29.16368214, 0))
point_2 = Point(Point(-21.57514339, -20.94908372, 11.68385586))
value_list = ValueList({"edgeLength", "sameWeight"}, selected="sameWeight")
value_list_2 = ValueList({"vertexGraph", "faceGraph"}, selected="faceGraph")
value_list_3 = ValueList({"dijkstra": "dijkstra_path", "shortest": "shortest_path"}, selected="dijkstra")
line = Line(StartPoint=point, EndPoint=point_2)
mesh = Mesh(<mesh referenced from the Rhino model>)
mesh_2 = Mesh(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)
panel = Panel("http://127.0.0.1:5000/MeshPathWalker")
bounding_box = BoundingBox(Content=mesh, Plane=PlaneXY(0, 0, 0))  # -> Box, Box_2
number_slider = Slider(0.49, range=0..1)
number_slider_2 = Slider(0.66, range=0..1)
number_slider_3 = Slider(0.64, range=0..1)
number_slider_4 = Slider(0.84, range=0..1)
deconstruct_brep = DeconstructBrep(Brep=bounding_box.Box)  # -> Faces, Edges, Vertices
list_item = ListItem(List=deconstruct_brep.Faces, Index=0, Wrap=True)  # -> Item, Item1, Item2
vector_xyz = VectorXYZ(XComponent=number_slider_2, YComponent=number_slider, ZComponent=0)  # -> Vector, Length
vector_xyz_2 = VectorXYZ(XComponent=number_slider_4, YComponent=number_slider_3, ZComponent=0)  # -> Vector, Length
evaluate_surface = EvaluateSurface(Surface=reparameterize(list_item.Item), Point=vector_xyz.Vector)  # -> Point, Normal, UDirection, VDirection, Frame
evaluate_surface_2 = EvaluateSurface(Surface=reparameterize(list_item.Item2), Point=vector_xyz_2.Vector)  # -> Point, Normal, UDirection, VDirection, Frame
line_2 = Line(StartPoint=evaluate_surface.Point, EndPoint=evaluate_surface_2.Point)
hops = Hops(
    Mesh=mesh,
    WeightMode=value_list,
    GraphType=value_list_2,
    SLine=line_2,
    Mode=value_list_3,
    CacheResultsInMemory=True,
    CacheSolveResults=True,
    RemoteDefinitionLocation="http://127.0.0.1:5000/MeshPathWalker",
    RemoteSolveVersion=(0, 1, 0))  # -> ShortestPath, FacesIndex
ghpython_script = GhPythonScript(m=mesh)  # -> out, a; inputs m: Mesh
# ---------- ghpython_script: Python ----------
import Rhino.Geometry as rg

mL = []

for f in range(m.Faces.Count):
    tempM = m.Duplicate()
    mL.append(tempM.Faces.ExtractFaces([f]))
    
a = mL
# ---------- end ghpython_script ----------
dotdisplay = DotDisplay(Point=hops.ShortestPath)
galapagos = Galapagos(fitness=area, gene=[number_slider, number_slider_2, number_slider_3, number_slider_4])
list_item_2 = ListItem(List=ghpython_script.a, Index=hops.FacesIndex, Wrap=True)
mesh_join = MeshJoin(Meshes=list_item_2)
area = Area(Geometry=mesh_join)  # -> Area, Centroid
custom_preview = CustomPreview(
    Geometry=mesh_join,
    Material={diffuse=RGB(221, 160, 221), emission=RGB(66, 48, 66), shine=0.5, specular=RGB(255, 255, 255), transparency=0})
