# Grasshopper definition geo-opt-session-2-topology.gh (Grasshopper 1.0.7)

file_path = FilePath("A:\Architektura prace\IAAC 3.S.3 aia-geo-opt\aia-geo-opt-git\aia-geo-opt_Mastalski\files\geo-opt-session-2-topology.py")
read_file = ReadFile(File=file_path, PerLineParse=False)
point = Point([Point(-6, -6, 0), Point(-6, 16, 0), Point(12, 23, 0), Point(6, 2, 0)])
ghpython_script = GhPythonScript(Code=read_file, Pts=point)  # -> Out, A
panel = Panel(ghpython_script.Out)
data = Data(ghpython_script.A)
