# Grasshopper definition geo-opt-session-4-18.05.2021.gh (Grasshopper 1.0.7)
# plug-ins: Hops, Weaverbird

hops = Hops(
    InputX=Slider(10, range=0..10),
    InputY=Slider(0, range=0..10),
    CacheResultsInMemory=True,
    CacheSolveResults=True,
    RemoteDefinitionLocation="http://127.0.0.1:5000/sample",
    RemoteSolveVersion=(0, 1, 0))
mesh = Mesh(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)
panel = Panel(hops)
weaverbird_s_dual_graph = WeaverbirdsDualGraph(MeshCurves=mesh, DualMode=0)
